# Grasshopper definition test.ghx (Grasshopper 1.0.7)
# plug-ins: TreeHopper

number_slider = Slider(0, range=0..1)
number_slider_2 = Slider(0, range=0..1)
c_script = CSharpScript(x=Toggle(False))  # -> out, A; inputs x: Boolean; disabled
# ---------- c_script: C# usings ----------
using Grasshopper.Kernel.Attributes;
using Grasshopper.GUI.Canvas;
using System.Drawing;
using Grasshopper.Kernel.Special;
# ---------- c_script: C# ----------
    foreach (IGH_DocumentObject comp in GrasshopperDocument.Objects){
      if ( comp.ComponentGuid.ToString() == "3581f42a-9592-4549-bd6b-1c0fc39d067b"){
        id = comp.InstanceGuid;
      }
    }

    if (x){
      Grasshopper.Kernel.Special.GH_Group g = new Grasshopper.Kernel.Special.GH_Group();
      g.NickName = "test";
      g.Colour = System.Drawing.Color.FromArgb(150, 150, 0, 0);
      g.Description = "Treehopper";
      GrasshopperDocument.AddObject(g, false, GrasshopperDocument.ObjectCount);
      g.AddObject(id);
      g.ExpireCaches();
    }
    else{
      List<IGH_DocumentObject> toDelete = new List<IGH_DocumentObject>();
      foreach (IGH_DocumentObject comp in GrasshopperDocument.Objects){
        if ( comp.Description == "Treehopper"){
          toDelete.Add(comp);
        }
      }
      if (toDelete.Count > 0){
        GrasshopperDocument.RemoveObjects(toDelete, false);
      }
    }
# ---------- c_script: C# additional code ----------
  Guid id;
# ---------- end c_script ----------
thz = TreeHopper(Open=Toggle(True), Version="0")  # -> Output, Version, Comp_params
python = GhPythonScript()  # -> Out, A
pt = ConstructPoint(XCoordinate=number_slider_2, YCoordinate=Slider(0.33, range=0..1), ZCoordinate=number_slider)
panel = Panel(thz.Comp_params)
addition = Addition(A=number_slider_2, B=number_slider)
